% Simulink data dictionary ssl_robot.sldd

sat_v = Simulink.Parameter(3, DataType="double")
sat_w = Simulink.Parameter(10, DataType="double")
Ts = Simulink.Parameter(0.01666667, DataType="double")
K_vx = Simulink.Parameter(0.9885877, StorageClass="SimulinkGlobal", DataType="double", Min=0.5, Max=2)
tau_vx = Simulink.Parameter(0.1281724, StorageClass="SimulinkGlobal", DataType="double", Min=0.01, Max=0.5)
Td_vx = Simulink.Parameter(0.17075, StorageClass="SimulinkGlobal", DataType="double", Min=0, Max=0.2)
K_vy = Simulink.Parameter(0.9492958, StorageClass="SimulinkGlobal", DataType="double", Min=0.5, Max=2)
tau_vy = Simulink.Parameter(0.2415768, StorageClass="SimulinkGlobal", DataType="double", Min=0.01, Max=0.5)
Td_vy = Simulink.Parameter(0.10445, StorageClass="SimulinkGlobal", DataType="double", Min=0, Max=0.2)
K_w = Simulink.Parameter(1, StorageClass="SimulinkGlobal", DataType="double", Min=0.5, Max=2)
tau_w = Simulink.Parameter(0.1, StorageClass="SimulinkGlobal", DataType="double", Min=0.01, Max=0.5)
Td_w = Simulink.Parameter(0, StorageClass="SimulinkGlobal", DataType="double", Min=0, Max=0.2)